# Grasshopper definition fractal_tree_01.gh (Grasshopper 1.0.4)

max_horizontal_branches = Slider(3, range=1..6)
radius_to_length_proportion = Slider(5, range=0..100)
length_randomness = Slider(0, range=0..100)
angle_randomness = Slider(0, range=0..100)
radius_to_length_proportion_2 = Slider(11, range=0..100)
radius_to_length_proportion_3 = Slider(11, range=0..100)
gravity_strength = Slider(0, range=0..100)
max_horizontal_branches_2 = Slider(4, range=1..6)
depth = Slider(4, range=1..15)
thicknress_change = Slider(0.6, range=-0.1..0.9)
length_randomness_2 = Slider(58, range=0..100)
length_change = Slider(0.9, range=-0.1..0.9)
starting_length = Slider(500, range=50..1000)
angle_randomness_2 = Slider(59, range=0..100)
length_randomness_3 = Slider(63, range=0..100)
length_randomness_4 = Slider(72, range=0..100)
radius_to_length_proportion_4 = Slider(20, range=0..100)
max_angle = Slider(45, range=5..90)
construct_point = ConstructPoint(XCoordinate=0, YCoordinate=0, ZCoordinate=0)
angle_randomness_3 = Slider(49, range=0..100)
construct_point_2 = ConstructPoint(XCoordinate=0, YCoordinate=0, ZCoordinate=0)
angle_randomness_4 = Slider(49, range=0..100)
construct_point_3 = ConstructPoint(XCoordinate=0, YCoordinate=0, ZCoordinate=0)
length_randomness_5 = Slider(0, range=0..100)
construct_point_4 = ConstructPoint(XCoordinate=0, YCoordinate=0, ZCoordinate=0)
angle_randomness_5 = Slider(0, range=0..100)
starting_ngon = Slider(5, range=1..15)
length_change_2 = Slider(0.7, range=-0.1..0.9)
starting_length_2 = Slider(241, range=50..1000)
depth_2 = Slider(6, range=1..15)
max_angle_2 = Slider(36, range=5..90)
length_change_3 = Slider(0.7, range=-0.1..0.9)
length_change_4 = Slider(0.7, range=-0.1..0.9)
depth_3 = Slider(5, range=1..15)
max_angle_3 = Slider(44, range=5..90)
starting_length_3 = Slider(243, range=50..1000)
depth_4 = Slider(5, range=1..15)
starting_length_4 = Slider(243, range=50..1000)
max_angle_4 = Slider(54, range=0..180)
max_angle_5 = Slider(44, range=5..90)
max_angle_6 = Slider(42, range=0..180)
max_angle_7 = Slider(80, range=0..180)
length_change_5 = Slider(0.8, range=-0.1..0.9)
starting_length_5 = Slider(570, range=50..1000)
max_angle_8 = Slider(56, range=5..90)
construct_point_5 = ConstructPoint(XCoordinate=0, YCoordinate=0, ZCoordinate=0)
starting_ngon_2 = Slider(8, range=1..15)
max_angle_9 = Slider(0, range=0..180)
starting_ngon_3 = Slider(7, range=1..15)
ghpython_script = GhPythonScript(
    anchorp=construct_point_4,
    depth=depth_2,
    angle=max_angle_2,
    length=starting_length_2,
    lvariation=length_change_2,
    aran=angle_randomness_2,
    lran=length_randomness_2)  # -> treelin, treept; inputs anchorp: Point3d
# ---------- ghpython_script: Python ----------
#importing grasshopper python modules
import rhinoscriptsyntax as rs
import Rhino.Geometry as rg

#importing generic modules
from math import cos
from math import sin
from math import radians
import random

#Inputs
#anchorp - point3D, anchor point
#depth - integer, recursion cnt
#angle - float, split base angle
#length - float, first branch length
#lvariation - float, length change with each branch
#aran - float, % of randomness in relation to base angle
#lran - float, % of randomness in relation to base length

#getting starting point from anchorpoint
x1 = anchorp.X
y1 = anchorp.Y
z1 = anchorp.Z

#setting base variables
x2 = x1
y2 = y1
z2 = z1

#base angle
anglerec = 0

#list of lines that form the tree, this is the output variable 
treelin = []


#recursive function
def fractal(depth , x2, y2, z2, length, anglerec, angle, lvariation, aran, lran):
    
    #test if depth>0
    if depth:
        
        #defining random angle variation and length variation
        arn = random.uniform(-angle/100*aran, angle/100*aran)
        lrn = random.uniform(-length/100*lran, length/100*lran)
        
        #defining points
        x1 = x2
        y1 = y2
        z1 = z2 
        z2 = z1 + (length+lrn)*cos(radians(anglerec))
        y2 = y1 + (length+lrn)*sin(radians(anglerec))
        
        #changing branch length dependant on branch depth
        length = length*lvariation
        
        #building points
        stpoint = [x1, y1, z1]
        endpoint = [x2, y2, z2]
        
        #building line between points
        treelin.append(rs.AddLine(stpoint, endpoint))
        
        #calling function with different angle parameter for branch splitting
        fractal(depth - 1 , x2, y2, z2, length, (anglerec+angle+arn), angle, lvariation, aran, lran)
        fractal(depth - 1 , x2, y2, z2, length, (anglerec-angle+arn), angle, lvariation, aran, lran)
        
#first recursive function call
fractal(depth, x2, y2, z2, length, anglerec, angle, lvariation, aran, lran)
# ---------- end ghpython_script ----------
ghpython_script_2 = GhPythonScript(
    anchorp=construct_point,
    depth=depth_3,
    angle=max_angle_3,
    angleh=max_angle_4,
    length=starting_length_3,
    lvariation=length_change_3,
    aran=angle_randomness_3,
    lran=length_randomness_3,
    radtolen=radius_to_length_proportion_2)  # -> out, flatlinep; inputs anchorp: Point3d
# ---------- ghpython_script_2: Python ----------
#importing grasshopper python modules
import rhinoscriptsyntax as rs
import Rhino.Geometry as rg
import ghpythonlib.parallel as ghp
import ghpythonlib.components as ghc
import Rhino as rc


#importing generic modules
from math import cos
from math import sin
from math import radians
import random

#Inputs
#anchorp - point3D, anchor point
#depth - integer, recursion cnt
#angle - float, split base angle
#length - float, first branch length
#lvariation - float, length change with each branch
#aran - float, % of randomness in relation to base angle
#lran - float, % of randomness in relation to base length
#radtolen - proportion between starting length branch depth and branch radius

#getting starting point from anchorpoint
x1 = anchorp.X
y1 = anchorp.Y
z1 = anchorp.Z

#setting base variables
x2 = x1
y2 = y1
z2 = z1

#base angle
anglerec = 0
anglerech = 0

#list of lines that form the tree, this is the output variable 
treelin = {}

anglest = []

#recursive function
def fractal(depth, x2, y2, z2, length, anglerec, angle, lvariation, aran, lran, anglerech, angleh):
    
    #test if depth>0
    if depth:
        
        #defining random angle variation and length variation
        arn = random.uniform(-angle/100*aran, angle/100*aran)
        lrn = random.uniform(-length/100*lran, length/100*lran)
        
        #defining horizontal rotation angles
        ahor = random.sample(range(0,360), 4)
        
        #removing numbers within tolerance
        ahr = rs.CullDuplicateNumbers(ahor, angleh)
        
        #in a 360 fashion
        if ahr[0]+360-angleh<ahr[-1]:
            del ahr[0]
        
        #defining points
        x1 = x2
        y1 = y2
        z1 = z2 
        x2 = x1 - (length+lrn)*sin(radians(anglerec))*sin(radians(anglerech))
        y2 = y1 + (length+lrn)*sin(radians(anglerec))*cos(radians(anglerech))
        z2 = z1 + (length+lrn)*cos(radians(anglerec))
        
        #changing branch length dependant on branch depth
        length = length*lvariation
        
        #building points
        stpoint = rg.Point3d(x1, y1, z1)
        endpoint = rg.Point3d(x2, y2, z2)
        
        #building line between points
        linegeo = rg.Line(stpoint, endpoint)
        
        #building a dict of lines with depth as key, and corresponding lines as values
        if depth not in treelin.keys():
            treelin[depth] = [linegeo]
        else: 
            treelin[depth].append(linegeo)
        
        #calling function with different angle parameter for branch splitting
        #calling as many branches as spread within tolerance
        if len(ahr) > 0:
            fractal(depth - 1 , x2, y2, z2, length, (anglerec+angle+arn), angle, lvariation, aran, lran, ahr[0], angleh)
        if len(ahr) > 1:
            fractal(depth - 1 , x2, y2, z2, length, (anglerec-angle+arn), angle, lvariation, aran, lran, ahr[1], angleh)
        if len(ahr) > 2:
            fractal(depth - 1 , x2, y2, z2, length, (anglerec+angle+arn), angle, lvariation, aran, lran, ahr[2], angleh)
        if len(ahr) > 3:
            fractal(depth - 1 , x2, y2, z2, length, (anglerec-angle+arn), angle, lvariation, aran, lran, ahr[3], angleh)
        
#first recursive function call
fractal(depth, x2, y2, z2, length, anglerec, angle, lvariation, aran, lran, anglerech, angleh)

#sort dict of branch lines
treelinsorted = {}
branch = depth

for key in treelin.keys():
    treelinsorted[branch] = treelin[key]
    branch -= 1

#maybe implement intersect tests between branches
def removeintersections():
    pass
    #events = Rhino.Geometry.Intersect.Intersection.CurveCurve(curveA, curveB, intersection_tolerance, overlap_tolerance)

#function that create sphere capped pipes on lines
def pipes(args):
    crv, rad = args
    return ghc.Pipe(crv, rad, 1)

#paralle compute execution of pipes function
linep = []

for kk in treelinsorted.keys():
    args = [[treelinsorted[kk], (length*(lvariation**kk))/radtolen]]
    linep.append(ghp.run(pipes, args, True))

#flatten a list of pipes for output
flatlinep = [y for x in linep for y in x]
# ---------- end ghpython_script_2 ----------
ghpython_script_3 = GhPythonScript(
    anchorp=construct_point_2,
    depth=depth_4,
    angle=max_angle_5,
    angleh=max_angle_6,
    length=starting_length_4,
    lvariation=length_change_4,
    aran=angle_randomness_4,
    lran=length_randomness_4,
    radtolen=radius_to_length_proportion_3,
    mngon=starting_ngon_2)  # -> out, flatlinep, stpnt, endpnt, vect, pln, pgons, joined; inputs anchorp: Point3d
# ---------- ghpython_script_3: Python ----------
#importing grasshopper python modules
import rhinoscriptsyntax as rs
import Rhino.Geometry as rg
import ghpythonlib.parallel as ghp
import ghpythonlib.components as ghc
import Rhino as rc


#importing generic modules
from math import cos
from math import sin
from math import radians
import random

#Inputs
#anchorp - point3D, anchor point
#depth - integer, recursion cnt
#angle - float, split base angle
#length - float, first branch length
#lvariation - float, length change with each branch
#aran - float, % of randomness in relation to base angle
#lran - float, % of randomness in relation to base length
#radtolen - proportion between starting length branch depth and branch radius

#getting starting point from anchorpoint
x1 = anchorp.X
y1 = anchorp.Y
z1 = anchorp.Z

#setting base variables
x2 = x1
y2 = y1
z2 = z1

#base angle
anglerec = 0
anglerech = 0

#list of lines that form the tree, this is the output variable 
treelin = {}

anglest = []

#recursive function
def fractal(depth, x2, y2, z2, length, anglerec, angle, lvariation, aran, lran, anglerech, angleh):
    
    #test if depth>0
    if depth:
        
        #defining random angle variation and length variation
        arn = random.uniform(-angle/100*aran, angle/100*aran)
        lrn = random.uniform(-length/100*lran, length/100*lran)
        
        #defining horizontal rotation angles
        ahor = random.sample(range(0,360), 4)
        
        #removing numbers within tolerance
        ahr = rs.CullDuplicateNumbers(ahor, angleh)
        
        #in a 360 fashion
        if ahr[0]+360-angleh<ahr[-1]:
            del ahr[0]
        
        #defining points
        x1 = x2
        y1 = y2
        z1 = z2 
        x2 = x1 - (length+lrn)*sin(radians(anglerec))*sin(radians(anglerech))
        y2 = y1 + (length+lrn)*sin(radians(anglerec))*cos(radians(anglerech))
        z2 = z1 + (length+lrn)*cos(radians(anglerec))
        
        #changing branch length dependant on branch depth
        length = length*lvariation
        
        #building points
        stpoint = rg.Point3d(x1, y1, z1)
        endpoint = rg.Point3d(x2, y2, z2)
        
        #building line between points
        linegeo = rg.Line(stpoint, endpoint)
        
        #building a dict of lines with depth as key, and corresponding lines as values
        if depth not in treelin.keys():
            treelin[depth] = [linegeo]
        else: 
            treelin[depth].append(linegeo)
        
        #calling function with different angle parameter for branch splitting
        #calling as many branches as spread within tolerance
        if len(ahr) > 0:
            fractal(depth - 1 , x2, y2, z2, length, (anglerec+angle+arn), angle, lvariation, aran, lran, ahr[0], angleh)
        if len(ahr) > 1:
            fractal(depth - 1 , x2, y2, z2, length, (anglerec-angle+arn), angle, lvariation, aran, lran, ahr[1], angleh)
        if len(ahr) > 2:
            fractal(depth - 1 , x2, y2, z2, length, (anglerec+angle+arn), angle, lvariation, aran, lran, ahr[2], angleh)
        if len(ahr) > 3:
            fractal(depth - 1 , x2, y2, z2, length, (anglerec-angle+arn), angle, lvariation, aran, lran, ahr[3], angleh)
        
#first recursive function call
fractal(depth, x2, y2, z2, length, anglerec, angle, lvariation, aran, lran, anglerech, angleh)

#sort dict of branch lines
treelinsorted = {}
branch = depth

for key in treelin.keys():
    treelinsorted[branch] = treelin[key]
    branch -= 1

#maybe implement intersect tests between branches
def removeintersections():
    pass
    #events = Rhino.Geometry.Intersect.Intersection.CurveCurve(curveA, curveB, intersection_tolerance, overlap_tolerance)

#output list
pgons = []

#create ngon branch depth dependant
def ngons(args):
    nn, length, lvariation, kk, radtolen, mngon, depth = args
    stpnt = ghc.EndPoints(nn)[0] #returns list of two points, start and end
    endpnt = ghc.EndPoints(nn)[1]
    vect = ghc.Vector2Pt(stpnt, endpnt, False)[0] #returns list with vector and vector length
    pln = ghc.PlaneNormal(stpnt, vect) #returns a plane perp to a vector
    radius = length*(lvariation**kk)/radtolen
        
    #reduce details with each branch, but not less than 3
    if mngon-kk+1 <= 3:
        splits = 3
    else:
        splits = mngon-kk+1
    
    pgn = ghc.Polygon(pln, radius, splits, 0)[0] #returns a polygon and its perimeter
    
    if kk == depth and splits == 3:
        geo = ghc.ExtrudePoint(pgn, endpnt) #if last branch than make a pyramid
    else:
        geo = ghc.Extrude(pgn, vect) #extrudes the polygon along vector
    
    return ghc.CapHoles(geo) #caps ends on the extruded brep

#iterate over branches and run ngons func
for kk in treelinsorted.keys():
    for nn in treelinsorted[kk]:
        args = [nn, length, lvariation, kk, radtolen, mngon, depth]
        pgons.append(ngons(args))

def joiner(breps):
    return ghc.SolidUnion(breps)

#joined = joiner(pgons)
# ---------- end ghpython_script_3 ----------
ghpython_script_4 = GhPythonScript(
    anchorp=construct_point_3,
    depth=Slider(4, range=0..10),
    branches=max_horizontal_branches_2,
    angle=max_angle_8,
    angleh=max_angle_9,
    length=starting_length_5,
    lvariation=length_change_5,
    aran=angle_randomness_5,
    lran=length_randomness_5,
    radtolen=radius_to_length_proportion_4,
    mngon=starting_ngon_3)  # -> out, flatlinep, stpnt, endpnt, vect, pln, treelinout, pgons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; inputs anchorp: Point3d, branches: Int32
# ---------- ghpython_script_4: Python ----------
#importing grasshopper python modules
import rhinoscriptsyntax as rs
import Rhino.Geometry as rg
import ghpythonlib.parallel as ghp
import ghpythonlib.components as ghc
import Rhino as rc


#importing generic modules
from math import cos
from math import sin
from math import radians
import random

#Inputs
#anchorp - point3D, anchor point
#depth - integer, recursion cnt
#angle - float, split base angle
#length - float, first branch length
#lvariation - float, length change with each branch
#aran - float, % of randomness in relation to base angle
#lran - float, % of randomness in relation to base length
#radtolen - proportion between starting length branch depth and branch radius

#getting starting point from anchorpoint
x1 = anchorp.X
y1 = anchorp.Y
z1 = anchorp.Z-length #to generate starting vector

#setting base variables
x2 = x1
y2 = y1 
z2 = 0 #to generate starting vector

#base angle
anglerec = 0
anglerech = 0

#list of lines that form the tree, this is the output variable 
treelin = {}
anglest = []

#recursive function
def fractal(depth, x1, y1, z1, x2, y2, z2, length, anglerec, angle, lvariation, aran, lran, anglerech, angleh, branches):
    
    #test if depth>0
    if depth:
        
        #defining random angle variation and length variation
        arn = random.uniform(-angle/100*aran, angle/100*aran)
        lrn = random.uniform(-length/100*lran, length/100*lran)
        
        #defining horizontal rotation angles
        ahor = random.sample(range(0,360), branches)
        
        #removing numbers within tolerance
        ahr = rs.CullDuplicateNumbers(ahor, angleh)
        
        #in a 360 fashion
        if ahr[0]+360-angleh<ahr[-1]:
            del ahr[0]
            
        random.shuffle(ahr)
        
        #previous branch vector
        
        vecst = rg.Point3d(x1, y1, z1)
        vecend = rg.Point3d(x2, y2, z2)
        
        movevec = ghc.Vector2Pt(vecst, vecend, True)[0] #returns vector and it's length
        
        #perpendicular vector rotation plane
        
        rotplane3 = ghc.PlaneNormal(vecend, movevec) #creates plane perpendicular to vector
        plns = ghc.DeconstructPlane(rotplane3) #origin, x, y, z
        rotplane = ghc.ConstructPlane(plns[0], plns[3], plns[2]) #constructing new plane switching x and y planes to make perpendicular
        
        #generating perpendicular vector
        vecperp = ghc.Rotate(movevec, radians(90), rotplane)[0]
        
        #generating vector amplitudes
        leny = (length+lrn)*sin(radians(anglerec+arn))
        lenz = (length+lrn)*cos(radians(anglerec+arn))
        ampy = ghc.Amplitude(vecperp, leny)
        ampz = ghc.Amplitude(movevec, lenz)
        
        #changing branch length dependant on branch depth
        length = length*lvariation
        
        #building points
        endpoint1 = ghc.Move(vecend, ampz)[0] #returns moved object and transformation data
        endpoint = ghc.Move(endpoint1, ampy)[0] #returns moved object and transformation data
        
        #rotating point in a cone fashion
        rotpoint = ghc.Rotate3D(endpoint, anglerech, vecend, movevec)[0] #returns rotated geometry and transformation data
        
        #building line between points
        linegeo = rg.Line(vecend, rotpoint)
        
        #setting coords for next branch
        x1 = x2
        y1 = y2
        z1 = z2
        
        #getting xyz from rotated point
        x2 = rg.Point3d(rotpoint)[0]
        y2 = rg.Point3d(rotpoint)[1]
        z2 = rg.Point3d(rotpoint)[2]
        
        #building a dict of lines with depth as key, and corresponding lines as values
        if depth not in treelin.keys():
            treelin[depth] = [linegeo]
        else: 
            treelin[depth].append(linegeo)
        
        #calling function with different angle parameter for branch splitting
        #calling as many branches as spread within tolerance
        for aa in ahr:
            fractal(depth - 1 , x1, y1, z1, x2, y2, z2, length, angle, angle, lvariation, aran, lran, aa, angleh, branches)
        

        
#first recursive function call
fractal(depth, x1, y1, z1, x2, y2, z2, length, anglerec, angle, lvariation, aran, lran, anglerech, angleh, branches)

#sort dict of branch lines
treelinsorted = {}
branch = depth

for key in treelin.keys():
    treelinsorted[branch] = treelin[key]
    branch -= 1

#maybe implement intersect tests between branches
def removeintersections():
    pass
    #events = Rhino.Geometry.Intersect.Intersection.CurveCurve(curveA, curveB, intersection_tolerance, overlap_tolerance)

#output list
pgons = []

#create ngon branch depth dependant
def ngons(args):
    
    nn, length, lvariation, kk, radtolen, mngon, depth = args
    
    stpnt = ghc.EndPoints(nn)[0] #returns list of two points, start and end
    endpnt = ghc.EndPoints(nn)[1]
    vect = ghc.Vector2Pt(stpnt, endpnt, False)[0] #returns list with vector and vector length
    pln = ghc.PlaneNormal(stpnt, vect) #returns a plane perp to a vector
    radius = length*(lvariation**kk)/radtolen
        
    #reduce details with each branch, but not less than 3
    if mngon-kk+1 <= 3:
        splits = 3
    else:
        splits = mngon-kk+1
    
    pgn = ghc.Polygon(pln, radius, splits, 0)[0] #returns a polygon and its perimeter
    
    if kk == depth and splits == 3:
        geo = ghc.ExtrudePoint(pgn, endpnt) #if last branch than make a pyramid
    else:
        geo = ghc.Extrude(pgn, vect) #extrudes the polygon along vector
    
    return ghc.CapHoles(geo) #caps ends on the extruded brep

#iterate over branches and run ngons func
for kk in treelinsorted.keys():
    for nn in treelinsorted[kk]:
        args = [nn, length, lvariation, kk, radtolen, mngon, depth]
        pgons.append(ngons(args))

def joiner(breps):
    return ghc.SolidUnion(breps)

#joined = joiner(pgons)
# ---------- end ghpython_script_4 ----------
ghpython_script_5 = GhPythonScript(
    anchorp=construct_point_5,
    depth=depth,
    branches=max_horizontal_branches,
    angle=max_angle,
    angleh=max_angle_7,
    length=starting_length,
    lvariation=length_change,
    aran=angle_randomness,
    lran=length_randomness,
    radtolen=radius_to_length_proportion,
    radchng=thicknress_change,
    mngon=starting_ngon,
    gravity=gravity_strength)  # -> out, flatlinep, stpnt, endpnt, vect, pln, treelinout, pgons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; inputs anchorp: Point3d, branches: Int32
# ---------- ghpython_script_5: Python ----------
#importing grasshopper python modules
import rhinoscriptsyntax as rs
import Rhino.Geometry as rg
import ghpythonlib.parallel as ghp
import ghpythonlib.components as ghc
import Rhino as rc


#importing generic modules
from math import cos
from math import sin
from math import radians
import random

#Inputs
#anchorp - point3D, anchor point
#depth - integer, recursion cnt
#angle - float, split base angle
#length - float, first branch length
#lvariation - float, length change with each branch
#aran - float, % of randomness in relation to base angle
#lran - float, % of randomness in relation to base length
#radtolen - proportion between starting length branch depth and branch radius

angle = angle*2

#getting starting point from anchorpoint
x1 = anchorp.X
y1 = anchorp.Y
z1 = anchorp.Z-length #to generate starting vector

#setting base variables
x2 = x1
y2 = y1 
z2 = 0 #to generate starting vector

#base angle
anglerec = 0
anglerech = 0

#list of lines that form the tree, this is the output variable 
treelin = {}
anglest = []
anglls = []
grav = []

#define xy vecotr for gravity reference
refp1 = rg.Point3d(0, 0, 0)
refp2 = rg.Point3d(0, 1, 0)
refp3 = rg.Point3d(0, 0, 1)
horizont = ghc.Vector2Pt(refp1, refp2, True)[0]
#vertical plane
verticalpln = ghc.Plane3Pt(refp1, refp3, refp2)


#recursive function
def fractal(depth, x1, y1, z1, x2, y2, z2, length, anglerec, angle, lvariation, aran, lran, anglerech, angleh, branches, gravity):
    
    #test if depth>0
    if depth:
        
        #defining random angle variation and length variation
        arn = random.uniform(-angle/100*aran, angle/100*aran)
        lrn = random.uniform(-length/100*lran, length/100*lran)
        
        #defining horizontal rotation angles
        ahor = random.sample(range(0,360), branches)
        """
        #removing numbers within tolerance
        ahr = rs.CullDuplicateNumbers(ahor, angleh)
        
        #in a 360 fashion
        if ahr[0]+360-angleh<ahr[-1]:
            del ahr[0]
            
        random.shuffle(ahr)
        """
        ahr = [0, 90, 270, 180]
        #previous branch vector
        
        vecst = rg.Point3d(x1, y1, z1)
        vecend = rg.Point3d(x2, y2, z2)
        
        movevec = ghc.Vector2Pt(vecst, vecend, True)[0] #returns vector and it's length
        
        #perpendicular vector rotation plane
        
        rotplane3 = ghc.PlaneNormal(vecend, movevec) #creates plane perpendicular to vector
        plns = ghc.DeconstructPlane(rotplane3) #origin, x, y, z
        rotplane = ghc.ConstructPlane(plns[0], plns[3], plns[2]) #constructing new plane switching x and y planes to make perpendicular
        
        #generating perpendicular vector
        vecperp = ghc.Rotate(movevec, radians(90), rotplane)[0]
        
        #generating vector amplitudes
        leny = (length+lrn)*sin(radians(anglerec+arn))
        lenz = (length+lrn)*cos(radians(anglerec+arn))
        ampy = ghc.Amplitude(vecperp, leny)
        ampz = ghc.Amplitude(movevec, lenz)
        
        #changing branch length dependant on branch depth
        length = length*lvariation
        
        #building points
        endpoint1 = ghc.Move(vecend, ampz)[0] #returns moved object and transformation data
        endpoint = ghc.Move(endpoint1, ampy)[0] #returns moved object and transformation data
        
        #rotating point in a cone fashion
        rotpoint = ghc.Rotate3D(endpoint, anglerech, vecend, movevec)[0] #returns rotated geometry and transformation data
        
        #vertical branch angle
        angl1 = ghc.Angle(rg.Line(vecend, rotpoint) , horizont, verticalpln)[0] #outputs angle and reflex
        angl = ghc.Degrees(angl1)
        
        anglls.append(angl)
        
        #rotate depending on how horizontal branch is
        if angl>0 and angl<180:
            if angl<89:
                grrot = ((30/100)*(100-(angl*0.9))/100)*gravity
            elif angl>91:
                grrot = ((30/100)*(100-((180-angl)*0.9))/100)*gravity
            
        try: 
            grrot == 0
            rotpoint = ghc.Rotate3D(rotpoint, grrot, vecend, verticalpln)[0]
        except:
            pass
        
        #building line between points
        linegeo = rg.Line(vecend, rotpoint)
        
        #setting coords for next branch
        x1 = x2
        y1 = y2
        z1 = z2
        
        #getting xyz from rotated point
        x2 = rg.Point3d(rotpoint)[0]
        y2 = rg.Point3d(rotpoint)[1]
        z2 = rg.Point3d(rotpoint)[2]
        
        #building a dict of lines with depth as key, and corresponding lines as values
        if depth not in treelin.keys():
            treelin[depth] = [linegeo]
        else: 
            treelin[depth].append(linegeo)
        
        #calling function with different angle parameter for branch splitting
        #calling as many branches as spread within tolerance
        for aa in ahr:
            fractal(depth - 1 , x1, y1, z1, x2, y2, z2, length, angle, angle, lvariation, aran, lran, aa, angleh, branches, gravity)
        

        
#first recursive function call
fractal(depth, x1, y1, z1, x2, y2, z2, length, anglerec, angle, lvariation, aran, lran, anglerech, angleh, branches, gravity)

#sort dict of branch lines
treelinsorted = {}
branch = depth

for key in treelin.keys():
    treelinsorted[branch] = treelin[key]
    branch -= 1

#maybe implement intersect tests between branches
def removeintersections():
    pass
    #events = Rhino.Geometry.Intersect.Intersection.CurveCurve(curveA, curveB, intersection_tolerance, overlap_tolerance)

#output list
pgons = []

#create ngon branch depth dependant
def ngons(args):
    
    nn, length, lvariation, kk, radtolen, mngon, depth, radchng = args
    
    stpnt = ghc.EndPoints(nn)[0] #returns list of two points, start and end
    endpnt = ghc.EndPoints(nn)[1]
    vect = ghc.Vector2Pt(stpnt, endpnt, False)[0] #returns list with vector and vector length
    pln = ghc.PlaneNormal(stpnt, vect) #returns a plane perp to a vector
    radius = length*(radchng**kk)/radtolen
        
    #reduce details with each branch, but not less than 3
    if mngon-kk+1 <= 3:
        splits = 3
    else:
        splits = mngon-kk+1
    
    pgn = ghc.Polygon(pln, radius, splits, 0)[0] #returns a polygon and its perimeter
    
    if kk == depth and splits == 3:
        geo = ghc.ExtrudePoint(pgn, endpnt) #if last branch than make a pyramid
    else:
        geo = ghc.Extrude(pgn, vect) #extrudes the polygon along vector
    
    return ghc.CapHoles(geo) #caps ends on the extruded brep

#iterate over branches and run ngons func
def makegeo(treelinsorted):
    for kk in treelinsorted.keys():
        for nn in treelinsorted[kk]:
            args = [nn, length, lvariation, kk, radtolen, mngon, depth, radchng]
            pgons.append(ngons(args))
            
ghp.run(makegeo, [treelinsorted], True)

def joiner(breps):
    return ghc.SolidUnion(breps)

#joined = joiner(pgons)
# ---------- end ghpython_script_5 ----------
degrees = Degrees(Radians=ghpython_script_5.anglls)
panel = Panel(ghpython_script_3.out)
panel_2 = Panel(ghpython_script_5.anglls)
panel_3 = Panel(degrees)
